# Dynamo graph Geometry_Surfaces_V1.dyndiffview.dyn (Dynamo 0.8.2.2392)

number = DoubleInput(10)
byCoordinates = Point.ByCoordinates(y=number)
number_2 = DoubleInput(5)
number_3 = DoubleInput(10)
byCoordinates_2 = Point.ByCoordinates(x=number_2, y=number_3, z=number_3)
number_4 = DoubleInput(15)
byCoordinates_3 = Point.ByCoordinates(x=number_4, y=number_4)
byThreePoints = Arc.ByThreePoints(firstPoint=byCoordinates, secondPoint=byCoordinates_2, thirdPoint=byCoordinates_3)
byCoordinates_4 = Point.ByCoordinates()
number_5 = DoubleInput(5)
byCoordinates_5 = Point.ByCoordinates(z=number_5)
byCoordinates_6 = Point.ByCoordinates(x=number)
byThreePoints_2 = Arc.ByThreePoints(firstPoint=byCoordinates_4, secondPoint=byCoordinates_5, thirdPoint=byCoordinates_6)
number_6 = DoubleInput(-5)
number_7 = DoubleInput(5)
byCoordinates_7 = Point.ByCoordinates(x=number_6, y=number_7)
byThreePoints_3 = Arc.ByThreePoints(firstPoint=byCoordinates_4, secondPoint=byCoordinates_7, thirdPoint=byCoordinates)
# note: Multiple creation methods exist for most Surfaces.  Surfaces, Polysurfaces (collections of Surfaces), and Nurbs Surfaces can be create by Points, Curves, and derived from other surfaces and solids
bySweep2Rails = Surface.BySweep2Rails(path=byThreePoints, guideRail=byThreePoints_2, profile=byThreePoints_3)

# group: a deletion
# note: Geometry is not the same as a Revit Element:
# Use Import Instance To create Revit Imports from Surfaces and Solids in any Revit Environment, use Points and Curves to place Family Instances, or create Form in Mass and Generic Model By Point (Adaptive Component) Families
byGeometries = ImportInstance.ByGeometries(bySweep2Rails)

number_8 = DoubleInput(10)
number_9 = DoubleInput(-10)
byCoordinates_8 = Point.ByCoordinates(x=number_8, y=number_9)
byCoordinates_9 = Point.ByCoordinates(y=number_9)
byStartPointEndPoint = Line.ByStartPointEndPoint(startPoint=byCoordinates_8, endPoint=byCoordinates_9)
create = List.Create(byStartPointEndPoint, byThreePoints_2)
byLoft = Surface.ByLoft(create)
area = Surface.Area(byLoft)
watch = Watch(area)
# note: Surfaces Joined as Polysurfaces can be evalued as a single entity
create_2 = List.Create(byLoft, bySweep2Rails)
byJoinedSurfaces = PolySurface.ByJoinedSurfaces(create_2)
area_2 = Surface.Area(byJoinedSurfaces)
watch_2 = Watch(area_2)
area_3 = Surface.Area(bySweep2Rails)
watch_3 = Watch(area_3)
number_10 = DoubleInput(0..1..0.1)
# note: Edges, Points and other features can be derived from Surfaces using "Actions" appropriate to those geometries
pointAtParameter = Surface.PointAtParameter(surface=bySweep2Rails, u=number_10, v=number_10, lacing=CrossProduct)
# note: Tip:  Uncheck "Preview Upstream" in Right Click Menu to isolate Geometry in the node
byControlPoints = NurbsSurface.ByControlPoints(controlVertices=pointAtParameter)
watch_3d = Watch3D(byControlPoints)
code_block = CodeBlock { 10; }
extrude = Curve.Extrude(curve=byThreePoints, distance=code_block)

# group: a deletion
referenceCurveByCurve = ModelCurve.ReferenceCurveByCurve(create)

# group: a deletion
byLoftCrossSections = Form.ByLoftCrossSections(referenceCurveByCurve)

# group: a addition
byGeometry = BoundingBox.ByGeometry()

# group: a addition
toCuboid = BoundingBox.ToCuboid()
