# Grasshopper definition simple_multiply_example.ghx (Grasshopper 0.9.76)

number = Number(4444)
number_2 = Number(8888)
multiplication = Multiplication(A=simplify(graft([Slider(3, range=0..10), Slider(3, range=0..10), number, number_2])), BBBB=reverse(flatten(9999)))
Z = Data(multiplication)
