# Grasshopper definition createCircle-thenArrayInCircle.ghx (Grasshopper 0.9.76)

circle = Circle(Plane=PlaneXY(0, 0, 0), Radius=Slider(295, range=0..1000))
divide_curve = DivideCurve(Curve=circle, Count=Slider(15, range=0..100), Kinks=False)  # -> Points, Tangents, Parameters
multiplication = Multiplication(A=Slider(21, range=0..100), B=Slider(3.5, range=0..10))
graft_tree = GraftTree(Tree=divide_curve.Points, IncludeEmptyLists=True, IncludeNullItems=True)
circle_2 = Circle(Plane=graft_tree, Radius=multiplication)
