# Grasshopper definition createCircle-thenCreateTwistyTower.ghx (Grasshopper 0.9.76)

multiplication = Multiplication(A=Slider(15, range=0..100), B=Slider(4.6, range=0..10))
polygon = Polygon(Plane=PlaneXY(0, 0, 0), Radius=multiplication, Segments=6, FilletRadius=0)  # -> Polygon, Length
unit_z = UnitZ(Factor=Slider(225, range=0..1000))
rotate = Rotate(Geometry=polygon.Polygon, Angle=1.570796327, Plane=PlaneXY(0, 0, 0))  # -> Geometry, Transform
move = Move(Geometry=rotate.Geometry, Motion=unit_z)  # -> Geometry, Transform
merge = Merge(Data1=polygon.Polygon, Data2=move.Geometry)
loft = Loft(Curves=merge, Options={Adjust=False, Closed=False, LoftEnds=0, LoftSimp=0, LoftType=0, Rebuild=10, Refit=0.01})
geometry = Geometry(loft)
