# Grasshopper definition new_Generated.ghx (Grasshopper 0.9.76)
# plug-ins: Human

panel = Panel()
slider = Slider(0.5, range=0..1)
docunits = ConvertToDocumentUnits(ValueString=panel)
merge = Merge(Data1=docunits, Data2=slider)
_2º = PowerOf2(Value=merge)
panel_2 = Panel(_2º)
