# Grasshopper definition versionTower-Flower_modified3.gh (Grasshopper 0.9.76)

construct_point = ConstructPoint(XCoordinate=0, YCoordinate=5, ZCoordinate=0)
circle = Circle(Plane=construct_point, Radius=Slider(70, range=0..1000))
number_slider = Slider(10, range=0..10)
divide_curve = DivideCurve(Curve=circle, Count=10, Kinks=False)  # -> Points, Tangents, Parameters
division = Division(A=Slider(160, range=0..1000), B=number_slider)
graft_tree = GraftTree(Tree=divide_curve.Points, IncludeEmptyLists=True, IncludeNullItems=True)
geometry = Geometry(graft_tree)
polygon = Polygon(Plane=geometry, Radius=Slider(19, range=0..100), Segments=Slider(8, range=0..10), FilletRadius=0)  # -> Polygon, Length
series = Series(Start=0, Step=division, Count=number_slider)
series_2 = Series(Start=0, Step=Slider(6.6, range=0..100), Count=number_slider)
radians = Radians(Degrees=series)
rotate = Rotate(Geometry=polygon.Polygon, Angle=radians, Plane=geometry)  # -> Geometry, Transform
gradient = Gradient(
    LowerLimit=0,
    UpperLimit=1,
    stops=[0: RGB(103, 0, 120), 0.165: RGB(39, 72, 161), 0.295: RGB(1, 192, 229), 0.452: RGB(18, 178, 90), 0.572: RGB(79, 186, 8), 0.663: RGB(220, 237, 32), 0.829: RGB(247, 159, 20), 1: RGB(243, 57, 0)])
unit_z = UnitZ(Factor=series_2)
move = Move(Geometry=rotate.Geometry, Motion=unit_z)  # -> Geometry, Transform
loft = Loft(Curves=move.Geometry, Options={Adjust=False, Closed=False, LoftEnds=0, LoftSimp=0, LoftType=0, Rebuild=10, Refit=0.01})
geometry_2 = Geometry(construct_point)
geometry_3 = Geometry(divide_curve.Points)
cap_holes = CapHoles(Brep=loft)
vector_2pt = Vector2Pt(PointA=geometry_2, PointB=geometry_3, Unitize=False)  # -> Vector, Length
unit_z_2 = UnitZ(Factor=1)
construct_plane = ConstructPlane(Origin=Point(0, 0, 0), XAxis=vector_2pt.Vector, YAxis=unit_z_2)  # -> graft(Plane)
scale_nu = ScaleNU(Geometry=cap_holes, Plane=construct_plane, ScaleX=Slider(1.375, range=0..10), ScaleY=1, ScaleZ=1)  # -> Geometry, Transform
swatch = Green(SwatchColor=RGB(0, 205, 0))
preview = CustomPreview(Geometry=scale_nu.Geometry, Shader=swatch)
