# Dynamo graph dy2.dyn (Dynamo 0.8.2.2392)
# a diff

code_block = CodeBlock { 2; }
number_slider = DoubleSlider(30.2, range=0..100 step 0.1)
add = code_block + number_slider
watch = Watch(add)
mul = code_block * _
