# Grasshopper definition versionA.ghx (Grasshopper 0.9.76)
# plug-ins: Human

panel = Panel()
slider = Slider(0.5, range=0..1)
docunits = ConvertToDocumentUnits(ValueString=panel)
merge = Merge(Data1=docunits, Data2=ColourSwatch(SwatchColor=RGB(255, 255, 255)), Data3=slider)
