# Grasshopper definition versionA2.ghx (Grasshopper 0.9.76)

multiplication = Multiplication(A=Slider(3, range=0..10), B=Slider(5, range=0..10))
number = Number(multiplication)
mass_addition = MassAddition(Input=["33", Slider(787, range=0..1000), number])  # -> Result, PartialResults
