# Grasshopper definition versionA3.ghx (Grasshopper 0.9.76)
# plug-ins: Python Interpreter

panel = Panel("""multipatch.shp
polylineZ.shp
line.shp
rectangle.shp""")
concat = Concatenate(Start="_Project", End=".shp")
rep = ReplaceString(String=panel, Find=".shp", Replace=concat, RecursiveReplace=False)
panel_2 = Panel(rep)
weave = Weave(Pattern=[0, 1], Stream0="lotsWGS84UTMZ10.shp", Stream1=rep, NullGaps=False)
item = ListItem(List=weave, Index=Slider(0, range=0..10), Wrap=False)
panel_3 = Panel(item)
concat_2 = Concatenate(Start="/Users/demonchaux/Dropbox/localcode/rhinotools/testdata/", End=item)
readshapefile = PythonScript(shapefile=concat_2, read=Toggle(False), moveToCenter=Toggle(True), GhMemory=0)  # -> out, geometry; inputs shapefile: String, read: Boolean, moveToCenter: Boolean
# ---------- readshapefile: Python ----------
#import Rhino
import os
import sys

# edit sys.path
package = '~/Dropbox/localcode/rhinotools'
expanded = os.path.abspath(os.path.expanduser(package))
if expanded not in sys.path:
    sys.path.append(expanded)

decom = [
    'Shp',
    'ShpFeature',
    'ShpToRhino',
    ]
for m in decom:
    if m in sys.modules:
        del sys.modules[m]

# get the module
import Shp
import ShpFeature
import ShpToRhino


if read:
    if shapefile:
        if not os.path.exists(shapefile):
            print 'The shapefile you gave me does not exist.\nDouble check the path: "%s"' % shapefile
        # import stuff
        out = ShpToRhino.ShpFileToRhino( shapefile, moveToCenter )
        geometry = out
    else:
        print 'no shapefile supplied'
# ---------- end readshapefile ----------
panel_4 = Panel(readshapefile.out)
split = SplitList(List=readshapefile.geometry, Index=Slider(10, range=0..2000))  # -> ListA, ListB
item_2 = ListItem(List=split.ListA, Index=Slider(6, range=0..200), Wrap=False)
geo = Geometry(item_2)
slider = Slider(8, range=0..10)
extractuserstrings = PythonScript(geometry=geo, GhMemory=0)  # -> out, U, K, V; inputs key: String
# ---------- extractuserstrings: Python ----------
if geometry:
    data = geometry.GetUserStrings()
    d = {}
    k = []
    v = []
    for u in data:
        k.append(u)
        d[u] = data[u]
        v.append(d[u])
    U = d
    K = k
    V = v
# ---------- end extractuserstrings ----------
item_3 = ListItem(List=extractuserstrings.V, Index=slider, Wrap=False)
item_4 = ListItem(List=extractuserstrings.K, Index=slider, Wrap=False)
python = PythonScript(U=extractuserstrings.U, K="ST_AREA_SH", GhMemory=0)  # -> Output, V
panel_5 = Panel(extractuserstrings.U)
panel_6 = Panel([item_4, item_3])
