# Grasshopper definition versionB2.ghx (Grasshopper 0.9.76)
# plug-ins: Python Interpreter, Kangaroo Components

timer = Timer(TimerInterval=1000, Target=python)
python = PythonScript(Run=Toggle(False))  # -> out, result
# ---------- python: Python ----------
import socket
import sys

if(Run):
    
    # Create a TCP/IP socket
    sock = socket.socket(socket.AF_INET, socket.SOCK_STREAM)
    
    # Connect the socket to the port where the server is listening
    server_address = ('0.tcp.ngrok.io', 57201)
    print >>sys.stderr, 'connecting to %s port %s' % server_address
    sock.connect(server_address)
    
    try:
    
        # Send data
        message = 'ping'
        print >>sys.stderr, 'sending "%s"' % message
        sock.sendall(message)
    
        data = sock.recv(16)
        print >>sys.stderr, 'received "%s"' % data
        result = data
    
    finally:
        print >>sys.stderr, 'closing socket'
        sock.close()
# ---------- end python ----------
tmatch = MatchText(Text=python.result, Pattern="yes", Case=True)
rec = DataRecorder(tmatch, DataLimit=-1, RecordData=True)
int = Integer(rec)
geo = Geometry(<mesh referenced from the Rhino model>)
ma = MassAddition(Input=int)  # -> Result, PartialResults
panel = Panel(rec)
bool = Boolean(ma.Result)
not = GateNot(A=bool)
timer_2 = Timer(TimerInterval=5, Target=counter)
counter = Counter(Reset=Toggle(False))
multiplication = Multiplication(A=counter, B=Slider(4.87, range=0..10))
panel_2 = Panel(counter)
graph = GraphMapper(
    multiplication,
    x0=0,
    x1=320,
    y0=0,
    y1=320,
    container_name="Bezier",
    cpx=[0, 0, 0.411231935, 1],
    cpy=[0, 0.7481881976, 1, 1])
neg = Negative(Value=graph)
number = Number(neg)
Z = UnitZ(Factor=neg)
multiplication_2 = Multiplication(A=number, B=panel_2)
move = Move(Geometry=geo, Motion=Z)  # -> Geometry, Transform
geo_2 = Geometry(move.Geometry)
panel_3 = Panel(multiplication_2)
preview = CustomPreview(Geometry=geo_2, Shader=ColourSwatch(SwatchColor=RGB(163, 15, 255)))
