# Grasshopper definition versionCircle-Extrude_Generated.ghx (Grasshopper 0.9.76)

multiplication = Multiplication(A=Slider(21, range=0..100), B=Slider(4.6, range=0..10))
circle = Circle(Plane=PlaneXY(0, 0, 0), Radius=multiplication)
unit_z = UnitZ(Factor=Slider(98, range=0..100))
extrude = Extrude(Base=circle, Direction=unit_z)
area = Area(Geometry=extrude)  # -> Area, Centroid
panel = Panel(area.Area)
