# Grasshopper definition versionCircle-makeMultiple_Generated.ghx (Grasshopper 0.9.76)

circle = Circle(Plane=PlaneXY(0, 0, 0), Radius=Slider(193, range=0..1000))
multiplication = Multiplication(A=Slider(21, range=0..100), B=Slider(4.6, range=0..10))
divide_curve = DivideCurve(Curve=circle, Count=10, Kinks=False)  # -> Points, Tangents, Parameters
circle_2 = Circle(Plane=divide_curve.Points, Radius=multiplication)
