# Grasshopper definition versionCircle.ghx (Grasshopper 0.9.76)

multiplication = Multiplication(A=Slider(21, range=0..100), B=Slider(4.6, range=0..10))
circle = Circle(Plane=PlaneXY(0, 0, 0), Radius=multiplication)
