# Grasshopper definition versionMultipleEdges-A.ghx (Grasshopper 0.9.76)

number_slider = Slider(3, range=0..10)
merge = Merge(Data1=number_slider, Data2=number_slider, Data3=number_slider, Data4=number_slider, Data5=Slider(4, range=0..10))
mass_addition = MassAddition(Input=merge)  # -> Result, PartialResults
panel = Panel(mass_addition.Result)
