# Grasshopper definition versionMultipleEdges-B.ghx (Grasshopper 0.9.76)

number_slider = Slider(5, range=0..10)
number_slider_2 = Slider(3, range=0..10)
merge = Merge(Data1=number_slider_2, Data2=number_slider_2, Data3=number_slider_2, Data4=number_slider_2, Data5=number_slider)
multiplication = Multiplication(A=merge, B=number_slider)
mass_addition = MassAddition(Input=merge)  # -> Result, PartialResults
panel = Panel(multiplication)
panel_2 = Panel(mass_addition.Result)
