# Grasshopper definition versionTower-Twist.ghx (Grasshopper 0.9.76)
# plug-ins: Kangaroo Components

timer = Timer(TimerInterval=20, Target=counter)
counter = Counter(Reset=Toggle(False))
multiplication = Multiplication(A=Slider(10, range=0..10), B=counter)
modulus = Modulus(A=multiplication, B=Slider(360, range=0..1000))
construct_point = ConstructPoint(XCoordinate=0, YCoordinate=0, ZCoordinate=0)
number_slider = Slider(10, range=0..10)
number_slider_2 = Slider(160, range=0..1000)
geometry = Geometry(construct_point)
division = Division(A=modulus, B=number_slider)
polygon = Polygon(Plane=geometry, Radius=Slider(12, range=0..100), Segments=Slider(8, range=0..10), FilletRadius=0)  # -> Polygon, Length
series = Series(Start=0, Step=division, Count=number_slider)
series_2 = Series(Start=0, Step=Slider(6.6, range=0..100), Count=number_slider)
radians = Radians(Degrees=series)
rotate = Rotate(Geometry=polygon.Polygon, Angle=radians, Plane=geometry)  # -> Geometry, Transform
unit_z = UnitZ(Factor=series_2)
move = Move(Geometry=rotate.Geometry, Motion=unit_z)  # -> Geometry, Transform
loft = Loft(Curves=move.Geometry, Options={Adjust=False, Closed=False, LoftEnds=0, LoftSimp=0, LoftType=0, Rebuild=10, Refit=0.01})
geometry_2 = Geometry(loft)
