# Grasshopper definition voxelizer_A.ghx (Grasshopper 0.9.76)
# plug-ins: Starling, syncFlounderCamera

pipeline = GeometryPipeline(
    GroupByLayer=False,
    GroupByType=False,
    IncludeHidden=True,
    IncludeLocked=True,
    LayerFilter="Positive",
    NameFilter="*",
    TypeFilter=1)
slhull3d = SlHull3D(Point3d=pipeline)
number_slider = Slider(5.085, range=3..10)
timer = Timer(TimerInterval=20, Target=syncfloundercamera)
geo = Geometry(slhull3d)
syncfloundercamera = SyncFlounderCamera(Activate=Toggle(True), SourceViewportName="InterfaceView", DestinationViewportName="RepresentationView")
medges = MeshEdges(Mesh=slhull3d)  # -> NakedEdges, InteriorEdges, NonManifoldEdges
create_boundinbox_around_geometry = Geometry(geo)
sph = Sphere(Base=pipeline, Radius=Slider(4, range=0..10))
geo_2 = Geometry([medges.NakedEdges, medges.InteriorEdges, medges.NonManifoldEdges])
preview = CustomPreview(Geometry=sph, Shader=ColourSwatch(SwatchColor=RGB(90, 88, 237)))
preview_2 = CustomPreview(Geometry=slhull3d, Shader=ColourSwatch(SwatchColor=RGBA(165, 237, 88, 58)))
preview_3 = CustomPreview(Geometry=geo_2, Shader=ColourSwatch(SwatchColor=RGB(34, 66, 0)))
makeptarray = MakePtArray(C=geo, num=number_slider)
# Get points inside volume (based on a resolution)
create_3d_array_of_points = Geometry(makeptarray)
ptinsidegeo = PtInsideGeo(geo=create_3d_array_of_points, M=geo)
find_only_points_that_are_inside_geometr = Geometry(ptinsidegeo)  # "find only points that are inside geometry"

num = Number(number_slider)
xy = XYPlane(Origin=find_only_points_that_are_inside_geometr)
division = Division(A=num, B="2")
box = CenterBox(Base=xy, X=division, Y=division, Z=division)

# ----
# create boxes on points
create_boxes_on_points = Data(find_only_points_that_are_inside_geometr)
panel = Panel("""20
33
34
54""")
ma = MassAddition(Input=panel)  # -> Result, PartialResults
# count boxes based on given ratio
count_boxes_based_on_given_ratio = Data(box)
lng = ListLength(List=box)
division_2 = Division(A=panel, B=ma.Result)
multiplication = Multiplication(A=lng, B=division_2)
int = Integer(multiplication)
partition = PartitionList(List=box, Size=int)  # -> simplify(Chunks)
lng_2 = ListLength(List=panel)
random = Random(Range=Domain(0, 1), Number=lng_2, Seed=Slider(0, range=0..10))
random_2 = Random(Range=Domain(0, 1), Number=lng_2, Seed=Slider(10, range=0..10))
random_3 = Random(Range=Domain(0, 1), Number=lng_2, Seed=Slider(6, range=0..10))
# display boxes with colors
display_boxes_with_colors = Data(count_boxes_based_on_given_ratio)
viewer = ParamViewer(partition)
frgb = ColourRGBF(Alpha=1, Red=random, Green=random_2, Blue=random_3)  # -> simplify(graft(Colour))
viewer_2 = ParamViewer(frgb)
preview_4 = CustomPreview(Geometry=partition, Shader=frgb)

# ==== cluster PtInsideGeo
geo = ClusterInput()
M = ClusterInput()
geo_2 = Geometry(geo)
minc = MeshInclusion(Mesh=M, Point=geo_2, Strict=False)
dispatch = Dispatch(List=geo_2, DispatchPattern=minc)  # -> ListA, ListB
A = ClusterOutput(dispatch.ListA)

# ==== cluster MakePtArray
C = ClusterInput()
num = ClusterInput()
bbox = BoundingBox(Content=C, Plane=PlaneXY(0, 0, 0), UnionBox=True)  # -> Box, Box_2
num_2 = Number(num)
debox = DeconstructBox(Box=bbox.Box)  # -> Plane, X, Y, Z
num_3 = Number(debox.Y)
num_4 = Number(debox.X)
num_5 = Number(debox.Z)
roundup = RoundUp(A=num_4, B=num_2)
roundup_2 = RoundUp(A=num_3, B=num_2)
roundup_3 = RoundUp(A=num_5, B=num_2)
debrep = DeconstructBrep(Brep=bbox.Box)  # -> Faces, Edges, Vertices
sort_pt = SortPoints(Points=debrep.Vertices)  # -> Points, Indices
item = ListItem(List=sort_pt.Points, Index=0, Wrap=True)
division = Division(A=num_2, B="2")
box = CenterBox(Base=PlaneXY(0, 0, 0), X=division, Y=division, Z=division)
arrbox = BoxArray(Geometry=item, Cell=box, XCount=roundup, YCount=roundup_2, ZCount=roundup_3)  # -> Geometry, Transform
G = ClusterOutput(arrbox.Geometry)

# ==== cluster RoundUp
A = ClusterInput()
B = ClusterInput()
division = Division(A=A, B=B)
round = Round(Number=division)  # -> Nearest, Floor, Ceiling
C = ClusterOutput(round.Ceiling)
