# Grasshopper definition voxelizer_B.ghx (Grasshopper 0.9.76)
# plug-ins: Starling, syncFlounderCamera

pipeline = GeometryPipeline(
    GroupByLayer=False,
    GroupByType=False,
    IncludeHidden=True,
    IncludeLocked=True,
    LayerFilter="Positive",
    NameFilter="*",
    TypeFilter=1)
stream_filter = StreamFilter(Gate=Toggle(False), Stream1=pipeline)
slhull3d = SlHull3D(Point3d=stream_filter)
number_slider = Slider(6.572, range=3..10)
timer = Timer(TimerInterval=20, Target=syncfloundercamera)
geo = Geometry(slhull3d)
syncfloundercamera = SyncFlounderCamera(Activate=Toggle(True), SourceViewportName="InterfaceView", DestinationViewportName="RepresentationView")
medges = MeshEdges(Mesh=slhull3d)  # -> NakedEdges, InteriorEdges, NonManifoldEdges
create_boundinbox_around_geometry = Geometry(geo)
sph = Sphere(Base=stream_filter, Radius=Slider(4, range=0..10))
geo_2 = Geometry([medges.NakedEdges, medges.InteriorEdges, medges.NonManifoldEdges])
preview = CustomPreview(Geometry=sph, Shader=ColourSwatch(SwatchColor=RGB(90, 88, 237)))
preview_2 = CustomPreview(Geometry=slhull3d, Shader=ColourSwatch(SwatchColor=RGBA(165, 237, 88, 58)))
preview_3 = CustomPreview(Geometry=geo_2, Shader=ColourSwatch(SwatchColor=RGB(34, 66, 0)))
makeptarray = MakePtArray(C=geo, num=number_slider)
# Get points inside volume (based on a resolution)
create_3d_array_of_points = Geometry(makeptarray)
ptinsidegeo = PtInsideGeo(geo=create_3d_array_of_points, M=geo)
find_only_points_that_are_inside_geometr = Geometry(ptinsidegeo)  # "find only points that are inside geometry"
# create boxes on points
create_boxes_on_points = Data(find_only_points_that_are_inside_geometr)
panel = Panel("""20
33
34
54""")
ma = MassAddition(Input=panel)  # -> Result, PartialResults
division = Division(A=panel, B=ma.Result)
lng = ListLength(List=panel)
random = Random(Range=Domain(0, 1), Number=lng, Seed=Slider(0, range=0..10))
random_2 = Random(Range=Domain(0, 1), Number=lng, Seed=Slider(2, range=0..10))
random_3 = Random(Range=Domain(0, 1), Number=lng, Seed=Slider(6, range=0..10))
frgb = ColourRGBF(Alpha=1, Red=random, Green=random_2, Blue=random_3)  # -> simplify(graft(Colour))
viewer = ParamViewer(frgb)

num = Number(number_slider)
xy = XYPlane(Origin=find_only_points_that_are_inside_geometr)

square_root = SquareRoot(Value=num)

box = CenterBox(Base=xy, X=square_root, Y=square_root, Z=square_root)

# ----
# count boxes based on given ratio
count_boxes_based_on_given_ratio = Data(box)
lng_2 = ListLength(List=box)
multiplication = Multiplication(A=lng_2, B=division)
int = Integer(multiplication)
partition = PartitionList(List=box, Size=int)  # -> simplify(Chunks)
# display boxes with colors
display_boxes_with_colors = Data(count_boxes_based_on_given_ratio)
viewer_2 = ParamViewer(partition)
preview_4 = CustomPreview(Geometry=partition, Shader=frgb)

# ==== cluster PtInsideGeo
geo = ClusterInput()
M = ClusterInput()
geo_2 = Geometry(geo)
minc = MeshInclusion(Mesh=M, Point=geo_2, Strict=False)
dispatch = Dispatch(List=geo_2, DispatchPattern=minc)  # -> ListA, ListB
A = ClusterOutput(dispatch.ListA)

# ==== cluster MakePtArray
C = ClusterInput()
num = ClusterInput()
bbox = BoundingBox(Content=C, Plane=PlaneXY(0, 0, 0), UnionBox=True)  # -> Box, Box_2
num_2 = Number(num)
debox = DeconstructBox(Box=bbox.Box)  # -> Plane, X, Y, Z
num_3 = Number(debox.Y)
num_4 = Number(debox.X)
num_5 = Number(debox.Z)
roundup = RoundUp(A=num_4, B=num_2)
roundup_2 = RoundUp(A=num_3, B=num_2)
roundup_3 = RoundUp(A=num_5, B=num_2)
debrep = DeconstructBrep(Brep=bbox.Box)  # -> Faces, Edges, Vertices
sort_pt = SortPoints(Points=debrep.Vertices)  # -> Points, Indices
item = ListItem(List=sort_pt.Points, Index=0, Wrap=True)
division = Division(A=num_2, B="2")
box = CenterBox(Base=PlaneXY(0, 0, 0), X=division, Y=division, Z=division)
arrbox = BoxArray(Geometry=item, Cell=box, XCount=roundup, YCount=roundup_2, ZCount=roundup_3)  # -> Geometry, Transform
G = ClusterOutput(arrbox.Geometry)

# ==== cluster RoundUp
A = ClusterInput()
B = ClusterInput()
division = Division(A=A, B=B)
round = Round(Number=division)  # -> Nearest, Floor, Ceiling
C = ClusterOutput(round.Ceiling)
