# Grasshopper definition towerflowertwist.ghx (Grasshopper 0.9.76)

counter = Counter(Reset=Toggle(False))
multiplication = Multiplication(A=Slider(10, range=0..10), B=counter)
construct_point = ConstructPoint(XCoordinate=0, YCoordinate=0, ZCoordinate=0)
modulus = Modulus(A=multiplication, B=Slider(360, range=0..1000))
circle = Circle(Plane=construct_point, Radius=Slider(70, range=0..1000))
number_slider = Slider(10, range=0..10)
number_slider_2 = Slider(160, range=0..1000)
divide_curve = DivideCurve(Curve=circle, Count=10, Kinks=False)  # -> Points, Tangents, Parameters
division = Division(A=modulus, B=number_slider)
graft_tree = GraftTree(Tree=divide_curve.Points, IncludeEmptyLists=True, IncludeNullItems=True)
geometry = Geometry(graft_tree)
polygon = Polygon(Plane=geometry, Radius=Slider(19, range=0..100), Segments=Slider(8, range=0..10), FilletRadius=0)  # -> Polygon, Length
series = Series(Start=0, Step=division, Count=number_slider)
series_2 = Series(Start=0, Step=Slider(6.6, range=0..100), Count=number_slider)
radians = Radians(Degrees=series)
rotate = Rotate(Geometry=polygon.Polygon, Angle=radians, Plane=geometry)  # -> Geometry, Transform
unit_z = UnitZ(Factor=series_2)
move = Move(Geometry=rotate.Geometry, Motion=unit_z)  # -> Geometry, Transform
geometry_2 = Geometry(construct_point)
geometry_3 = Geometry(divide_curve.Points)
loft = Loft(Curves=move.Geometry, Options={Adjust=False, Closed=False, LoftEnds=0, LoftSimp=0, LoftType=0, Rebuild=10, Refit=0.01})
cap_holes = CapHoles(Brep=loft)
vector_2pt = Vector2Pt(PointA=geometry_2, PointB=geometry_3, Unitize=False)  # -> Vector, Length
unit_z_2 = UnitZ(Factor=1)
geometry_4 = Geometry(loft)
construct_plane = ConstructPlane(Origin=Point(0, 0, 0), XAxis=vector_2pt.Vector, YAxis=unit_z_2)  # -> graft(Plane)
scale_nu = ScaleNU(Geometry=cap_holes, Plane=construct_plane, ScaleX=Slider(1.375, range=0..10), ScaleY=1, ScaleZ=1)  # -> Geometry, Transform
custom_preview = CustomPreview(
    Geometry=geometry_4,
    Shader={ambient=RGB(0, 0, 0), diffuse=RGB(255, 105, 180), emission=RGB(76, 32, 54), shine=0.5, specular=RGB(255, 255, 255), transparency=0})
